# Grasshopper definition Joints_Button.gh (Grasshopper 1.0.7)

pt = ConstructPoint(XCoordinate=0, YCoordinate=Slider(4, range=0..10), ZCoordinate=0)
cir = Circle(Plane=PlaneXY(0, 0, 0), Radius=Slider(10, range=0..100))
cir_2 = Circle(Plane=pt, Radius=Slider(1, range=0..10))
area = Area(Geometry=cir)  # -> Area, Centroid
arrpolar = PolarArray(Geometry=cir_2, Plane=area.Centroid, Count=Slider(5, range=0..10), Angle=6.283185307)  # -> Geometry, Transform
rdiff = RegionDifference(CurvesA=cir, CurvesB=arrpolar.Geometry)
boundary = BoundarySurfaces(Edges=rdiff)
Z = UnitZ(Factor=Slider(4, range=0..10))
extr = Extrude(Base=boundary, Direction=Z)
filedge = FilletEdge(Shape=extr, Blend=0, Metric=0, Edges=[Slider(1, range=0..3), Slider(2, range=0..3)], Radii=Slider(1.7, range=0..4))
preview = CustomPreview(
    Geometry=filedge,
    Material={diffuse=RGB(221, 160, 221), emission=RGB(66, 48, 66), shine=0.5, specular=RGB(255, 255, 255), transparency=0})
