# Grasshopper definition Joints_HalfBuckle.gh (Grasshopper 1.0.7)

xz = XZPlane(Origin=Point(0, 0, 0))
neg = Negative(Value=Slider(10, range=0..100))
Y = UnitY(Factor=neg)
crv = Curve(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)
move = Move(Geometry=crv, Motion=Y)  # -> Geometry, Transform
mirror = Mirror(Geometry=move.Geometry, Plane=xz)  # -> Geometry, Transform
disc = Discontinuity(Curve=move.Geometry, Level=1)  # -> Points, Parameters
number_slider = Slider(2, range=0..100)
number_slider_2 = Slider(12, range=0..100)
item = ListItem(List=disc.Points, Index=Slider(3, range=0..4), Wrap=True)
mirror_2 = Mirror(Geometry=item, Plane=xz)  # -> Geometry, Transform
neg_2 = Negative(Value=number_slider)
X = UnitX(Factor=Slider(10, range=1..20))
neg_3 = Negative(Value=number_slider_2)
dom = ConstructDomain(DomainStart=neg_3, DomainEnd=number_slider_2)
dom_2 = ConstructDomain(DomainStart=neg_2, DomainEnd=number_slider)
move_2 = Move(Geometry=mirror_2.Geometry, Motion=X)  # -> Geometry, Transform
rec_2pt = Rectangle2Pt(Plane=PlaneXY(0, 0, 0), PointA=item, PointB=move_2.Geometry, Radius=0)  # -> Rectangle, Length
area = Area(Geometry=rec_2pt.Rectangle)  # -> Area, Centroid
rectangle = Rectangle(Plane=area.Centroid, XSize=dom_2, YSize=dom, Radius=0)  # -> Rectangle, Length
merge = Merge(Data1=rec_2pt.Rectangle, Data2=mirror.Geometry, Data3=move.Geometry)
runion = RegionUnion(Curves=flatten(merge))
crv_2 = Curve(runion)
disc_2 = Discontinuity(Curve=crv_2, Level=1)  # -> Points, Parameters
item_2 = ListItem(List=disc_2.Parameters, Index=Slider(2, range=0..10), Wrap=True)  # -> Item, Item1

number_slider_3 = Slider(21, range=0..100)
number_slider_4 = Slider(15, range=0..100)
neg_4 = Negative(Value=number_slider_3)
neg_5 = Negative(Value=number_slider_4)
dom_3 = ConstructDomain(DomainStart=number_slider_4, DomainEnd=Slider(55, range=0..100))
dom_4 = ConstructDomain(DomainStart=neg_4, DomainEnd=number_slider_3)
rectangle_2 = Rectangle(Plane=PlaneXY(0, 0, 0), XSize=dom_3, YSize=dom_4, Radius=0)  # -> Rectangle, Length
rdiff = RegionDifference(CurvesA=rectangle_2.Rectangle, CurvesB=crv_2)
disc_3 = Discontinuity(Curve=rdiff, Level=1)  # -> Points, Parameters
item_3 = ListItem(List=disc_3.Points, Index=Slider(7, range=0..10), Wrap=True)  # -> Item, Item1, Item2
rec_3pt = Rectangle3Pt(PointA=item_3.Item, PointB=item_3.Item1, PointC=item_3.Item2)  # -> Rectangle, Length
rdiff_2 = RegionDifference(CurvesA=rdiff, CurvesB=rec_3pt.Rectangle)
Z = UnitZ(Factor=Slider(6, range=0..100))
boundary = BoundarySurfaces(Edges=rdiff_2)
extr = Extrude(Base=boundary, Direction=Z)
preview = CustomPreview(Geometry=extr, Material=ColourSwatch(SwatchColor=RGB(119, 90, 214)))

fillet = Fillet(Curve=crv_2, Parameter=item_2.Item, Radius=Slider(6.7, range=0..16))  # -> Curve, Parameter
merge_2 = Merge(Data1=fillet.Curve, Data2=rectangle.Rectangle)
Z_2 = UnitZ(Factor=Slider(6, range=0..10))
fillet_2 = Fillet(Curve=merge_2, Radius=Slider(1.2, range=0..16))
boundary_2 = BoundarySurfaces(Edges=flatten(fillet_2))
extr_2 = Extrude(Base=boundary_2, Direction=Z_2)
preview_2 = CustomPreview(
    Geometry=extr_2,
    Material={diffuse=RGB(221, 160, 221), emission=RGB(66, 48, 66), shine=0.5, specular=RGB(255, 255, 255), transparency=0})
