# Grasshopper definition Joints_Hook.gh (Grasshopper 1.0.7)
# plug-ins: Bifocals

pt = ConstructPoint(XCoordinate=Slider(21, range=0..100), YCoordinate=Slider(10, range=0..100), ZCoordinate=0)
pt_2 = ConstructPoint(XCoordinate=Slider(32, range=0..100), YCoordinate=Slider(22, range=0..100), ZCoordinate=0)
cir = Circle(Plane=pt, Radius=Slider(8, range=0..100))
rec_2pt = Rectangle2Pt(Plane=PlaneXY(0, 0, 0), PointA=Point(0, 0, 0), PointB=pt_2, Radius=0)  # -> Rectangle, Length
curvepoint = PointOnCurve(cir, parameter=0.301)
curvepoint_2 = PointOnCurve(cir, parameter=0.522)
crv_cp = CurveClosestPoint(Point=curvepoint, Curve=rec_2pt.Rectangle)  # -> Point, Parameter, Distance
rec_2pt_2 = Rectangle2Pt(Plane=PlaneXY(0, 0, 0), PointA=crv_cp.Point, PointB=curvepoint_2, Radius=0)  # -> Rectangle, Length
rdiff = RegionDifference(CurvesA=rec_2pt.Rectangle, CurvesB=rec_2pt_2.Rectangle)
trim = TrimWithRegion(Curve=rdiff, Region=cir)  # -> Inside, Outside
trim_2 = TrimWithRegions(Curve=cir, Regions=rec_2pt_2.Rectangle)  # -> Inside, Outside
crv = Curve(trim.Outside)
crv_2 = Curve(trim_2.Outside)
join = JoinCurves(Curves=flatten([crv, crv_2]), Preserve=False)
disc = Discontinuity(Curve=join, Level=1)  # -> Points, Parameters
item = ListItem(List=disc.Points, Index=Slider(5, range=0..10), Wrap=True)  # -> Item, Item1, Item2
rec_2pt_3 = Rectangle2Pt(Plane=PlaneXY(0, 0, 0), PointA=item.Item, PointB=item.Item2, Radius=0)  # -> Rectangle, Length
area = Area(Geometry=rec_2pt_3.Rectangle)  # -> Area, Centroid
fillet = Fillet(Curve=join, Radius=Slider(2, range=0..2))
scale_nu = ScaleNU(
    Geometry=rec_2pt_3.Rectangle,
    Plane=area.Centroid,
    ScaleX=Slider(0.4, range=0..1),
    ScaleY=Slider(0.7, range=0..1),
    ScaleZ=1)  # -> Geometry, Transform
merge = Merge(Data1=fillet, Data2=scale_nu.Geometry)
boundary = BoundarySurfaces(Edges=flatten(merge))
Z = UnitZ(Factor=Slider(2, range=0..10))
extr = Extrude(Base=boundary, Direction=Z)
cap = CapHoles(Brep=extr)
preview = CustomPreview(
    Geometry=cap,
    Material={diffuse=RGB(221, 160, 221), emission=RGB(66, 48, 66), shine=0.5, specular=RGB(255, 255, 255), transparency=0})
