# Grasshopper definition Joints_Thread.gh (Grasshopper 1.0.7)
# plug-ins: Kangaroo2 Components

# ---- group: Helix
helix_radius = Slider(0.5, range=0..1)
number_slider = Slider(2, range=0..8)
radius = Slider(5, range=0..60)
series = Series(Start=0, Step=Slider(0.2, range=0..1), Count=Slider(132, range=0..1000))
expression = Expression(x=series, r=radius, f=number_slider, Expression="r*Cos(x*f)")
expression_2 = Expression(y=series, r=radius, f=number_slider, Expression="r*Sin(y*f)")
pt = ConstructPoint(XCoordinate=expression, YCoordinate=expression_2, ZCoordinate=series)
intcrv = Interpolate(Vertices=pt, Degree=3, Periodic=False, KnotStyle=1)  # -> Curve, Length, Domain
mp = MultiPipe(Curves=intcrv.Curve, NodeSize=helix_radius, EndOffset=1, StrutSize=1, Segment=0, KinkAngle=0.6, CubeFit=0, Caps=1)

# ---- group: Outer Cylinder
number_slider_2 = Slider(4.852, range=0..100)
cyl = Cylinder(Base=PlaneXY(0, 0, 0), Radius=number_slider_2, Length=Slider(30, range=0..100))
cyl_2 = Cylinder(Base=PlaneXY(0, 0, 0), Radius=Slider(6.295, range=0..100), Length=Slider(26, range=0..100))
cap = CapHoles(Brep=cyl)
cap_2 = CapHoles(Brep=cyl_2)
sdiff = SolidDifference(BrepsA=cap_2, BrepsB=cap)

# ----
inner_r_reduction_in_mm = Slider(0.3, range=0..1)
division = Division(A=helix_radius, B=2)
addition = Addition(A=division, B=number_slider_2)
number_slider_3 = Slider(26, range=0..100)
subtraction = Subtraction(A=addition, B=inner_r_reduction_in_mm)

# ---- group: Cut planes
pt_2 = ConstructPoint(XCoordinate=0, YCoordinate=0, ZCoordinate=number_slider_3)
pt_3 = ConstructPoint(XCoordinate=0, YCoordinate=0, ZCoordinate=0)
addition_2 = Addition(A=addition, B=5)

# ----
meshsubd = MeshFromSubD(SubD=mp, Density=2)
mesh = Mesh(sdiff)
cyl_3 = Cylinder(Base=PlaneXY(0, 0, 0), Radius=number_slider_2, Length=number_slider_3)
division_2 = Division(A=subtraction, B=addition)
cyl_4 = Cylinder(Base=pt_2, Radius=addition_2, Length=5)
cyl_5 = Cylinder(Base=pt_3, Radius=addition_2, Length=-5)
cap_3 = CapHoles(Brep=cyl_3)
cap_4 = CapHoles(Brep=cyl_4)
cap_5 = CapHoles(Brep=cyl_5)
Y = UnitY(Factor=Slider(20, range=0..100))
mdif = MeshDifference(MeshesA=mesh, MeshesB=meshsubd)
mesh_2 = Mesh(cap_5)
mesh_3 = Mesh(cap_4)
munion = MeshUnion(Meshes=flatten([cap_3, meshsubd]))
move = Move(Geometry=mdif, Motion=Y)  # -> Geometry, Transform
# Radius must be
# reduced at ~0.6 mm
# to fit outer part
# after printing
scale_nu = ScaleNU(Geometry=munion, Plane=PlaneXY(0, 0, 0), ScaleX=division_2, ScaleY=division_2, ScaleZ=1)  # -> Geometry, Transform
mdif_2 = MeshDifference(MeshesA=scale_nu.Geometry, MeshesB=[mesh_3, mesh_2])
preview = CustomPreview(
    Geometry=scale_nu.Geometry,
    Material={diffuse=RGB(221, 160, 221), emission=RGB(66, 48, 66), shine=0.5, specular=RGB(255, 255, 255), transparency=0})
preview_2 = CustomPreview(Geometry=move.Geometry, Material=ColourSwatch(SwatchColor=RGB(133, 150, 212)))
